% Simulink data dictionary AEB_Data.sldd

Min_Dis_Stop_Veh = Simulink.Parameter(2, DataType="uint8", Unit="m")
Out_Rang = Simulink.Parameter(300, DataType="uint16")
Reac_Time = Simulink.Parameter(1, DataType="uint8", Unit="Sec")
AEB_Warning = Simulink.Parameter(1)
No_Warning = Simulink.Parameter(0)
AEB_Brake_Apply = Simulink.Parameter(1)
Driving_Mode_Active = Simulink.Parameter(1, DataType="boolean")
Reverse_Mode_Active = Simulink.Parameter(0, DataType="boolean")
CAN_Bus_Load_Range = Simulink.Parameter(70, DataType="uint8", Unit="%")
Radar_Temp_Lower_Tshld = Simulink.Parameter(-40, DataType="int8", Unit="°C")
Radar_Temp_Upper_Tshld = Simulink.Parameter(85, DataType="uint8", Unit="°C")
Camera_Range_Lower_Tshld = Simulink.Parameter(1, DataType="uint8", Unit="meter")
Camera_Range_Upper_Tshld = Simulink.Parameter(150, DataType="uint8", Unit="meter")
Lidar_Temp_Lower_Tshld = Simulink.Parameter(-20, DataType="int8", Unit="°C")
LIdar_Temp_Upper_Tshld = Simulink.Parameter(60, DataType="uint8", Unit="°C")
ECU_Voltage_Lower_Tshld = Simulink.Parameter(10, DataType="uint8", Unit="V")
ECU_Voltage_Upper_Tshld = Simulink.Parameter(18, DataType="uint8", Unit="V")
Gravity = Simulink.Parameter(9.81, DataType="single", Unit="m/s^2")
L_Limit = Simulink.Parameter(-1.1, DataType="single")
R_Limit = Simulink.Parameter(1.1, DataType="single")
Friction = Simulink.Parameter(0.7, DataType="single", Min=0, Max=1, Unit="newton")
Growth_Time_Dec = Simulink.Parameter(0.1, DataType="single")
Divide_Value = Simulink.Parameter(2, DataType="uint8")
Radar_Range_Lower_Tshld = Simulink.Parameter(2, DataType="uint8", Unit="meter")
Radar_Range_Upper_Tshld = Simulink.Parameter(250, DataType="uint8", Unit="meter")
Radar_Speed_Upper_Tshld = Simulink.Parameter(300, DataType="uint16", Unit="km/hr")
Lidar_Range_Lower_Tshld = Simulink.Parameter(1, DataType="uint8", Unit="meter")
Lidar_Range_Upper_Tshld = Simulink.Parameter(200, DataType="uint8", Unit="meter")
Lidar_Speed_Lower_Tshld = Simulink.Parameter(1, DataType="uint8", Unit="km/hr")
Lidar_Speed_Upper_Tshld = Simulink.Parameter(200, DataType="uint8", Unit="km/hr")
ECU_Resp_Time_Tshld = Simulink.Parameter(100, DataType="uint8", Unit="ms")
Brake_Resp_Time_Tshld = Simulink.Parameter(150, DataType="uint8", Unit="ms")
Brake_Hyd_Press_Lower_Tshld = Simulink.Parameter(290, DataType="uint16", Unit="psi")
Brake_Hyd_Press_Upper_Tshld = Simulink.Parameter(2175, DataType="uint16", Unit="psi")
Brake_Temp_Lower_Tshld = Simulink.Parameter(20, DataType="uint8", Unit="°C")
Brake_Temp_Upper_Tshld = Simulink.Parameter(100, DataType="uint8", Unit="°C")
Brake_Fluid_Level_Tshld = Simulink.Parameter(50, DataType="uint8", Unit="%")
ECU_Temp_Lower_Tshld = Simulink.Parameter(-40, DataType="int8", Unit="°C")
ECU_Temp_Upper_Tshld = Simulink.Parameter(85, DataType="uint8", Unit="°C")
Radar_Speed_Lower_Tshld = Simulink.Parameter(1, DataType="uint16", Unit="km/hr")